# Grasshopper definition WoodColumnCrossSection.gh (Grasshopper 0.9.76)
# plug-ins: Python Interpreter

width_mm = Panel("""50
38
50
50
75
50
50
63
50
50
100
50
75
75
75
125
75
100
150
100
175
200""")

# ---- group: Support conditions column
list = ValueList({"Simply supported both ends": 1, "One end fixed and one end not supported": 2, "One end fixed and one end simply supported": 0.699, "Both ends fixed": 1/2}, selected="One end fixed and one end not supported")

# ----
panel = Panel("Savskåret træ")

# ---- group: Strength class wood
strength_class_for_wood = ValueList({"C30": 30, "C24": 24, "C18": 18, "C14": 14, "GL32": 32, "Gl28": 28, "GL24": 24}, selected="C14")

# ----
# "Calculation of minimum required cross section of wooden columns"
# 
# "2017"
# 
# Created by Mikkel Dohm Andersen
load_in_n = Slider(1000, range=0..1000)
height_mm = Panel("""50
73
75
100
75
125
150
125
175
200
100
225
150
175
200
125
225
200
150
225
175
200""")
wy_10_3_mm_3 = Panel("""20.8
33.8
46.9
83.3
70.3
130
187.5
164
255
333
166.5
422
281
383
500
326
633
667
563
844
893
1335""")
pt = ConstructPoint(XCoordinate=0, YCoordinate=0, ZCoordinate=0)
pt_2 = ConstructPoint(XCoordinate=0, YCoordinate=0, ZCoordinate=Slider(3000, range=0..10000))
ln = Line(StartPoint=pt, EndPoint=pt_2)
wz_10_3_mm_3 = Panel("""20.8
17.57
31.3
41.7
70.3
52.1
62.5
82.7
72.9
83.3
166.5
93.8
140.5
164
187.5
326
211
333
563
375
893
1335""")
iy_10_6_mm_4 = Panel("""0.521
1.232
1.760
4.17
2.64
8.14
14.05
10.25
22.3
33.3
8.33
47.5
21.1
33.5
50
20.3
71.2
66.7
42.2
94.9
78.2
133.5""")

# ---- group: Calculate required moment of inertia python
calculate_required_moment_of_inertia = PythonScript(Ncr=load_in_n, E=strength_class_for_wood, SupCon=list, CL=ln)  # -> out, I
# ---------- calculate_required_moment_of_inertia: Python ----------
import math as m
import rhinoscriptsyntax as rs

ls = rs.CurveLength(CL)*SupCon
I = (m.pow(ls,2)*Ncr)/(m.pow(m.pi,2)*E)
print(I)
# ---------- end calculate_required_moment_of_inertia ----------

# ---- group: Calculate required moment of inertia expression
beregning_af_inertimoment_expression = BeregningAfInertimomentExpression(load=load_in_n, strength_class_wood=strength_class_for_wood, support_conditions=list, centerline_for_column=ln)  # disabled

# ----
iz_10_6_mm_4 = Panel("""0.521
0.334
0.781
1.04
2.64
1.3
1.56
2.6
1.825
2.08
8.33
2.34
5.27
6.15
7.03
20.3
7.91
16.65
42.2
18.75
78.2
133.5""")
panel_2 = Panel(calculate_required_moment_of_inertia.I)

# ---- group: Calculate required moment of inertia components
beregning_af_inertimoment_med_komponente = BeregningAfInertimomentMedKomponenter()  # "Beregning af inertimoment med komponenter"; disabled

# ==== cluster BeregningAfInertimomentExpression
centerline_for_column = ClusterInput()  # Input center line for column
strength_class_wood = ClusterInput()  # Strength class of wood for column
line = Line(centerline_for_column)
support_conditions = ClusterInput()  # Insert support conditions
load = ClusterInput()  # Critical vertical load
line_2 = Line(line)
len = Length(Curve=line_2)
num = Number(support_conditions)
num_2 = Number(strength_class_wood)
num_3 = Number(load)
multiplication = Multiplication(A=num, B=len)
expression = Expression(Ncr=num_3, E=num_2, ls=multiplication, Expression="(ls^2*Ncr)/(Pi^2*E)")
num_4 = Number(expression)
momen_of_inertia = ClusterOutput(num_4)  # Moment of inertia needed to take the given load

# ==== cluster BeregningAfInertimomentMedKomponenter
num = ClusterInput()
num_2 = ClusterInput()
line = ClusterInput()
num_3 = ClusterInput()
num_4 = Number(num)
num_5 = Number(num_2)
line_2 = Line(line)
num_6 = Number(num_3)
pi = Pi(Factor=1)
len = Length(Curve=line_2)
sqr = Square(Value=pi)
multiplication = Multiplication(A=num_6, B=len)
multiplication_2 = Multiplication(A=num_5, B=sqr)
sqr_2 = Square(Value=multiplication)
multiplication_3 = Multiplication(A=num_4, B=sqr_2)
division = Division(A=multiplication_3, B=multiplication_2)
num_7 = Number(division)
num_8 = ClusterOutput(num_7)
